# Dynamo graph FinalCircularWindowMatchMaker.dyn (Dynamo 2.19.3.6394)

export_file_path = Directory("C:\Users\jorgt\OneDrive\Bureaublad\Work\03. Test_results\Testproject_3_MP1000_MedTol")
duplicate_original_file = Python(IN[0]=export_file_path)  # CPython3
# ---------- duplicate_original_file.python (46 lines) ----------
import clr
clr.AddReference('RevitAPI')
clr.AddReference('RevitServices')
from Autodesk.Revit.DB import *
from RevitServices.Persistence import DocumentManager
import shutil
import os
import tempfile

# Inputs
directory_path = IN[0]  # Directory path input

# Access the current Revit document
doc = DocumentManager.Instance.CurrentDBDocument

# Function to generate a new file name with "_Original" appended
def generate_new_filename(directory_path, current_name):
    base_name = os.path.splitext(current_name)[0]  # Remove the extension
    new_filename = "{}_Original.rvt".format(base_name)
    return os.path.join(directory_path, new_filename)

# Get the current document's title (which is the file name without the extension)
current_doc_title = doc.Title

# Generate the new file path
new_file_path = generate_new_filename(directory_path, current_doc_title)

# Get the temporary file path
temp_dir = tempfile.gettempdir()
temp_file_path = os.path.join(temp_dir, current_doc_title + ".rvt")

# Save the current document to the temporary file path
try:
    save_options = SaveAsOptions()
    save_options.OverwriteExistingFile = True
    doc.SaveAs(temp_file_path, save_options)
    
    # Copy the temporary file to the new file path
    shutil.copy(temp_file_path, new_file_path)
    
    # Delete the temporary file
    os.remove(temp_file_path)
    
    OUT = "File saved successfully at: {}".format(new_file_path)
except Exception as e:
    OUT = "Failed to save file: {}".format(str(e))
# ----------------------------------------
gwp_param_adding_script = Python(IN[0]=export_file_path)  # CPython3
# ---------- gwp_param_adding_script.python (136 lines) ----------
import clr
clr.AddReference('RevitAPI')
clr.AddReference('RevitServices')
clr.AddReference('RevitNodes')

import Revit
from RevitServices.Persistence import DocumentManager
from Autodesk.Revit.DB import FilteredElementCollector, BuiltInCategory, Transaction, FamilyManager, FamilyParameter, ForgeTypeId, SpecTypeId, BuiltInParameterGroup, TransactionStatus, FailureHandlingOptions

# Get the current document
doc = DocumentManager.Instance.CurrentDBDocument

def start_transaction(document, name):
    """Start a transaction with a given name."""
    transaction = Transaction(document, name)
    transaction.Start()
    return transaction

def commit_transaction(transaction):
    """Commit the current transaction."""
    if not transaction.HasEnded():
        status = transaction.Commit()
        if status != TransactionStatus.Committed:
            raise Exception(f"Transaction could not be committed. Status: {status}")

def rollback_transaction(transaction):
    """Rollback the current transaction."""
    if not transaction.HasEnded():
        transaction.RollBack()

try:
    # Collect all family types that belong to the class "Windows"
    print("Collecting window family types...")
    window_family_types = FilteredElementCollector(doc) \
        .OfCategory(BuiltInCategory.OST_Windows) \
        .WhereElementIsElementType() \
        .ToElements()
    print(f"Found {len(window_family_types)} window family types.")

    for family_type in window_family_types:
        family = family_type.Family
        print(f"Processing family: {family.Name}")

        # Start transaction to ensure no conflicts before editing
        try:
            print(f"Starting transaction to ensure no conflicts before editing: {family.Name}")
            t = start_transaction(doc, f"Prepare to Edit Family {family.Name}")

            # Ensure previous transactions are done before editing family
            if not t.HasEnded():
                print(f"Committing transaction before editing family document: {family.Name}")
                commit_transaction(t)

            # Open the family document for editing
            print(f"Attempting to edit family document: {family.Name}")
            family_doc = doc.EditFamily(family)
            print(f"Opened family document for editing: {family.Name}")

            # Add a new parameter to the family
            family_manager = family_doc.FamilyManager

            try:
                # Start a transaction for modifying the family document
                t = start_transaction(family_doc, f"Modify Family {family.Name}")

                # Check if the parameter already exists
                param = family_manager.get_Parameter('GWP (KG CO2eq)')
                if param is None:
                    # Define the group type and parameter type for the parameter
                    group_type_id = ForgeTypeId(BuiltInParameterGroup.PG_DATA)
                    spec_type_id = SpecTypeId.Number  # Correct spec type for numeric values

                    # Add the new parameter if it does not exist
                    print(f"Adding new parameter to family: {family.Name}")
                    new_param = family_manager.AddParameter(
                        'GWP (KG CO2eq)',
                        group_type_id,
                        spec_type_id,
                        False  # Assuming this is a type parameter, set to True if it should be an instance parameter
                    )
                    print(f"Added new parameter to family: {family.Name}")
                else:
                    new_param = param
                    print(f"Parameter already exists in family: {family.Name}")

                # Set the formula for the parameter
                formula = "((Width*Height)/1) * 156.01"
                print(f"Setting formula '{formula}' for parameter '{new_param.Definition.Name}' in family: {family.Name}")

                try:
                    family_manager.SetFormula(new_param, formula)
                    print(f"Successfully set formula for family: {family.Name}")
                except Exception as e:
                    print(f"Error setting formula for parameter '{new_param.Definition.Name}' in family '{family.Name}': {e}")
                    raise  # Re-raise the exception to handle it in the outer catch block

                # Commit the transaction for the family document
                print(f"Committing transaction for family document: {family.Name}")
                commit_transaction(t)

                # Save changes to the family document
                try:
                    print(f"Saving changes to family document: {family.Name}")
                    family_doc.Save()  # Save instead of SaveAs
                    print(f"Saved changes to family document: {family.Name}")
                except Exception as e:
                    print(f"Error saving family document {family.Name}: {e}")
                    continue

            finally:
                # Ensure the family document is properly closed
                try:
                    print(f"Closing family document: {family.Name}")
                    if not t.HasEnded():
                        commit_transaction(t)  # Ensure the transaction is committed before closing
                    family_doc.Close(False)
                    print(f"Closed family document: {family.Name}")
                except Exception as e:
                    print(f"Error closing family document {family.Name}: {e}")

            print(f"Completed processing family: {family.Name}")

        except Exception as e:
            # Rollback if something goes wrong
            if 't' in locals() and not t.HasEnded():
                rollback_transaction(t)
            # Print the error message if an exception occurs
            OUT = str(e)
            print(f"Exception: {e}")

    OUT = "Parameters added and formula set for all window family types."

except Exception as e:
    # Print the error message if an exception occurs
    OUT = str(e)
    print(f"Exception: {e}")
# ----------------------------------------
watch = Watch(gwp_param_adding_script)
string = StringInput("Windows")
database_excel = Filename("Work\02. Marketplace_Databases\window_geometries_2000_items.xlsx")
tolerance = DoubleSlider(50, range=0..100 step 0.1)
sheetname = StringInput("Sheet1")
matchmaking_script = Python(IN[0]=string, IN[1]=database_excel, IN[2]=tolerance, IN[3]=sheetname)  # CPython3
# ---------- matchmaking_script.python (185 lines) ----------
import sys
import clr
clr.AddReference('ProtoGeometry')
from Autodesk.DesignScript.Geometry import *
clr.AddReference("RevitServices")
from RevitServices.Persistence import DocumentManager
from RevitServices.Transactions import TransactionManager
clr.AddReference("RevitAPI")
from Autodesk.Revit.DB import FilteredElementCollector
from Autodesk.Revit.DB import StorageType

dataEnteringNode = IN
import pandas as pd
import numpy as np

category_name = IN[0]  # Extract the category name from the list
Windoworiginalfile1 = pd.read_excel(IN[1], sheet_name=IN[3], keep_default_na=False)
tolerance = IN[2]

# Define a function to get elements of a specific category
def get_elements_of_category(doc, category_name):
    category = None
    for cat in doc.Settings.Categories:
        if cat.Name == category_name:
            category = cat
            break

    if not category:
        raise ValueError(f"Category '{category_name}' not found.")

    collector = FilteredElementCollector(doc).OfCategoryId(category.Id).WhereElementIsNotElementType()
    elements = collector.ToElements()
    return elements

# Function to get specified parameters from elements
def get_element_parameters(elements):
    param_data = {
        "ID": [],
        "Family": [],
        "FamilyType": [],
        "Width": [],
        "Height": [],
        "GWP (KG CO2eq)": []
    }

    for element in elements:
        param_data["ID"].append(element.Id.IntegerValue)
        param_data["Family"].append(element.Symbol.Family.Name)
        param_data["FamilyType"].append(element.Name)

        # Get the family symbol (type) of the element
        family_symbol = element.Symbol

        # Look for width, height, and GWP parameters on the family symbol
        width_param = family_symbol.LookupParameter("Width")
        height_param = family_symbol.LookupParameter("Height")
        gwp_param = family_symbol.LookupParameter("GWP (KG CO2eq)")

        # Print width and height values for debugging
        if width_param and width_param.StorageType == StorageType.Double:
            width_value = width_param.AsDouble() * 304.8  # Convert from feet to mm
            print("Width:", width_value)
            param_data["Width"].append(width_value)
        else:
            print("Width: None")
            param_data["Width"].append(None)

        if height_param and height_param.StorageType == StorageType.Double:
            height_value = height_param.AsDouble() * 304.8  # Convert from feet to mm
            print("Height:", height_value)
            param_data["Height"].append(height_value)
        else:
            print("Height: None")
            param_data["Height"].append(None)

        if gwp_param and gwp_param.StorageType == StorageType.Double:
            gwp_value = gwp_param.AsDouble()
            print("GWP (KG CO2eq):", gwp_value)
            param_data["GWP (KG CO2eq)"].append(gwp_value)
        else:
            print("GWP (KG CO2eq): None")
            param_data["GWP (KG CO2eq)"].append(None)

    return param_data

def find_matching_windows(data_model, Windoworiginalfile1, tolerance):
    matching_windows = []
    matched_original_ids = set()

    for _, window in data_model.iterrows():
        if window['Width'] is not None and window['Height'] is not None:
            min_width = window['Width'] - tolerance
            max_width = window['Width'] + tolerance
            min_height = window['Height'] - tolerance
            max_height = window['Height'] + tolerance

            matching_window = Windoworiginalfile1[
                (Windoworiginalfile1['Width'] >= min_width) &
                (Windoworiginalfile1['Width'] <= max_width) &
                (Windoworiginalfile1['Height'] >= min_height) &
                (Windoworiginalfile1['Height'] <= max_height)
            ].copy()

            if not matching_window.empty:
                matching_window = matching_window[~matching_window['ID'].isin(matched_original_ids)]

                if not matching_window.empty:
                    matching_window['Distance'] = np.sqrt(
                        (matching_window['Width'] - window['Width'])**2 +
                        (matching_window['Height'] - window['Height'])**2
                    )

                    matching_window = matching_window.sort_values(by='Distance')

                    closest_match = matching_window.iloc[0]

                    matched_window_data = {
                        'Original_Window_ID': window['ID'],
                        'ID': closest_match['ID'],
                        'Width': closest_match['Width'],
                        'Height': closest_match['Height'],
                        'GWP (KG CO2eq)': window['GWP (KG CO2eq)'],
                        'Match_found': True,
                        'Family': window['Family'],
                        'FamilyType': window['FamilyType']
                    }

                    matching_windows.append(matched_window_data)
                    matched_original_ids.add(closest_match['ID'])
                else:
                    no_match = {
                        'Original_Window_ID': window['ID'],
                        'ID': 'NA',
                        'Width': 'NA',
                        'Height': 'NA',
                        'GWP (KG CO2eq)': window['GWP (KG CO2eq)'],
                        'Match_found': False,
                        'Family': window['Family'],
                        'FamilyType': window['FamilyType']
                    }
                    matching_windows.append(no_match)
            else:
                no_match = {
                    'Original_Window_ID': window['ID'],
                    'ID': 'NA',
                    'Width': 'NA',
                    'Height': 'NA',
                    'GWP (KG CO2eq)': window['GWP (KG CO2eq)'],
                    'Match_found': False,
                    'Family': window['Family'],
                    'FamilyType': window['FamilyType']
                }
                matching_windows.append(no_match)

    return matching_windows

# Main process wrapped in a try-except block
try:
    # Get the current Revit document
    doc = DocumentManager.Instance.CurrentDBDocument

    # Get elements of the specified category
    elements = get_elements_of_category(doc, category_name)

    # Extract parameters from elements
    element_parameters = get_element_parameters(elements)

    # Create a DataFrame for the data model
    data_model = pd.DataFrame(element_parameters)

    # Find matching windows
    matched_windows = find_matching_windows(data_model, Windoworiginalfile1, tolerance)

    # Output the matched windows list
    OUT = matched_windows

    # Print the matched windows
    for mw in matched_windows:
        print(mw)

except Exception as e:
    # Print or log the error message
    error_message = "An error occurred: " + str(e)
    print(error_message)
    OUT = error_message
# ----------------------------------------
new_familytype_creation_script = Python(IN[0]=matchmaking_script)  # CPython3
# ---------- new_familytype_creation_script.python (204 lines) ----------
import clr
import sys
import System
import time  # Import time module for timestamp generation
import os
import shutil
from Autodesk.DesignScript.Geometry import *
from Autodesk.Revit.DB import *
from Autodesk.Revit.DB import UnitUtils, UnitTypeId, IFamilyLoadOptions
import RevitServices
from RevitServices.Persistence import DocumentManager
from RevitServices.Transactions import TransactionManager

# Data entering the node
dataEnteringNode = IN

matched_windows_data = IN[0]  # The incoming matched windows data

class CustomFamilyLoadOptions(IFamilyLoadOptions):
    def OnFamilyFound(self, familyInUse, overwriteParameterValues):
        overwriteParameterValues.Value = True
        return True

    def OnSharedFamilyFound(self, sharedFamilyInUse, source, overwriteParameterValues):
        overwriteParameterValues.Value = True
        return True

def get_family_by_name(doc, family_name):
    collector = FilteredElementCollector(doc).OfClass(Family)
    for family in collector:
        if family.Name == family_name:
            return family
    return None

def generate_new_type_name(family_name, base_name, width, height, existing_types):
    timestamp = int(time.time() * 1000)
    new_type_name = f"{family_name}_{base_name}_{int(width)}x{int(height)}_{timestamp}"
    # Check if the generated name already exists, if so, modify it until it's unique
    while new_type_name in existing_types:
        timestamp += 1
        new_type_name = f"{family_name}_{base_name}_{int(width)}x{int(height)}_{timestamp}"
    return new_type_name

def create_new_family_type(doc, family, family_type_name, width, height, existing_types):
    family_doc = None
    t = None
    new_type_name = None
    new_path = None  # Initialize new_path variable
    family_doc_name = None  # Initialize family_doc_name variable
    new_family_doc_name = None  # Initialize new_family_doc_name variable

    try:
        print(f"Attempting to open the family document for family: {family.Name}")
        family_doc = doc.EditFamily(family)
        if family_doc and family_doc.IsValidObject:
            print(f"Successfully opened family document for family: {family.Name}")
        else:
            print(f"Failed to open family document for family: {family.Name}")
            return None, None, None, None

        t = Transaction(family_doc, "Create new family type")
        t.Start()

        family_manager = family_doc.FamilyManager

        print("Attempting to access the FamilyManager...")
        if family_manager:
            print("FamilyManager accessed successfully.")

            new_type_name = generate_new_type_name(family.Name, family_type_name, width, height, existing_types)
            print(f"Generated new family type name: {new_type_name}")

            width_param = family_manager.get_Parameter("Width")
            height_param = family_manager.get_Parameter("Height")

            if width_param and height_param:
                print("Width and height parameters found.")

                new_family_type = family_manager.NewType(new_type_name)
                family_manager.CurrentType = new_family_type

                # Convert width and height to internal units
                width_internal = UnitUtils.ConvertToInternalUnits(width, UnitTypeId.Millimeters)
                height_internal = UnitUtils.ConvertToInternalUnits(height, UnitTypeId.Millimeters)

                family_manager.Set(width_param, width_internal)
                family_manager.Set(height_param, height_internal)

                print(f"Width and height parameters set successfully for FamilyType: {new_type_name}.")

                t.Commit()
                t = None

                # Get the original file path of the family document
                original_path = family_doc.PathName

                # Print the directory path where the file will be saved
                save_directory = os.path.dirname(original_path)
                new_filename = os.path.basename(original_path)  # Get the original filename

                # Generate new path for the saved family document
                new_path = os.path.join(save_directory, new_filename)

                # Delete the existing file if it exists
                if os.path.exists(new_path):
                    os.remove(new_path)

                # Save the modified family document to a new location
                family_doc.SaveAs(new_path)
                print(f"Family document saved to {new_path}")

                # Assign the name of the family document
                family_doc_name = family_doc.Title

                # Create a duplicate of the family file
                new_family_file_path, new_family_name = create_duplicate_and_rename(new_path)
                print(f"Created duplicate family file: {new_family_file_path}")

                # Set new family document name
                new_family_doc_name = new_family_name

            else:
                print("Width or height parameter not found or is not valid.")
        else:
            print("Failed to access the FamilyManager.")

    except Exception as e:
        if t and t.HasStarted():
            t.RollBack()
        print(f"An error occurred while updating FamilyType. Error: {str(e)}")
    finally:
        if family_doc and family_doc.IsValidObject:
            family_doc.Close(False)
            print(f"Family document closed successfully for family: {family_type_name} belonging to Family: {family.Name}")
        else:
            print("Family document is not a valid object anymore.")
    
    return new_type_name, new_family_file_path, family_doc_name, new_family_doc_name

def get_family_name_from_path(family_file_path):
    return os.path.splitext(os.path.basename(family_file_path))[0]

def create_duplicate_and_rename(family_file_path):
    family_name = get_family_name_from_path(family_file_path)
    directory, original_file_name = os.path.split(family_file_path)
    base_name, extension = os.path.splitext(original_file_name)
    
    # Check for existing files with similar names and increment the counter accordingly
    counter = 1
    new_file_name = f"{base_name}_{counter}{extension}"
    new_family_file_path = os.path.join(directory, new_file_name)

    while os.path.exists(new_family_file_path):
        counter += 1
        new_file_name = f"{base_name}_{counter}{extension}"
        new_family_file_path = os.path.join(directory, new_file_name)

    shutil.copy2(family_file_path, new_family_file_path)
    return new_family_file_path, new_file_name

def process_family_data(family_data):
    created_families = []
    for family_info in family_data:
        family_name, family_file_path = family_info[0], family_info[1]
        print(f"Processing family: {family_name} from file: {family_file_path}")
        new_family_file_path, new_family_name = create_duplicate_and_rename(family_file_path)
        created_families.append((new_family_name, new_family_file_path))
    return created_families

try:
    doc = DocumentManager.Instance.CurrentDBDocument

    existing_types = set()  # Collect existing types here
    loaded_families = []  # Initialize list to store loaded family details

    # Loop through matched windows data
    for window in matched_windows_data:
        if window['Match_found']:
            existing_types.add(window['FamilyType'])
            family_name = window['Family']
            family_type_name = window['FamilyType']
            width = window['Width']
            height = window['Height']

            # Retrieve the family by name
            family = get_family_by_name(doc, family_name)
            if family is None:
                print(f"Family '{family_name}' not found.")
                continue

            # Create new family type
            new_type_name, family_doc_path, family_doc_name, new_family_doc_name = create_new_family_type(doc, family, family_type_name, width, height, existing_types)
            if not new_type_name:
                print(f"Failed to create new family type for window with FamilyType: {family_type_name} belonging to Family: {family.Name}")
            else:
                print(f"Successfully created new family type '{new_type_name}' for window with FamilyType: {family_type_name} belonging to Family: {family.Name}")
                # Append family details to the list
                loaded_families.append([new_family_doc_name, family_doc_path, new_type_name, window])

    OUT = loaded_families
except Exception as e:
    error_message = "An error occurred: " + str(e)
    print(error_message)
    OUT = error_message
# ----------------------------------------
typeid_original_extraction = Python(IN[0]=new_familytype_creation_script)  # "TypeID (original) extraction script"; CPython3
# ---------- typeid_original_extraction.python (46 lines) ----------
import clr
clr.AddReference('RevitAPI')
clr.AddReference('RevitServices')
from Autodesk.Revit.DB import *
from RevitServices.Persistence import DocumentManager
from RevitServices.Transactions import TransactionManager

# Input data
data = IN[0]

# Get the current document
doc = DocumentManager.Instance.CurrentDBDocument

# Output list for TypeIDs
output_type_ids = []

# Extract ElementIds from data
element_ids = [sublist[3]['Original_Window_ID'] for sublist in data]

print(element_ids)

# Retrieve TypeIDs for each ElementId
for element_id in element_ids:
    try:
        print(f"Processing ElementId: {element_id}")
        
        # Get the element by ElementId
        element = doc.GetElement(ElementId(int(element_id)))
        
        if element:
            # Get the TypeId of the element
            type_id = element.GetTypeId()
            
            if type_id != ElementId.InvalidElementId:
                output_type_ids.append({'ElementId': element_id, 'TypeID': type_id.IntegerValue})
            else:
                output_type_ids.append({'ElementId': element_id, 'TypeID': None, 'Error': "Invalid Type ID"})
        else:
            output_type_ids.append({'ElementId': element_id, 'Error': f"Element with ID {element_id} not found"})
    
    except Exception as e:
        print(f"Error processing ElementId {element_id}: {str(e)}")
        output_type_ids.append({'ElementId': element_id, 'Error': str(e)})

# Output result
OUT = element_ids
# ----------------------------------------
translation_script = Python(IN[0]=typeid_original_extraction)  # CPython3
# ---------- translation_script.python (26 lines) ----------
import clr
# Import Revit API
clr.AddReference('RevitAPI')
from Autodesk.Revit.DB import ElementId

# Import RevitServices for accessing the Revit document
clr.AddReference('RevitServices')
import RevitServices
from RevitServices.Persistence import DocumentManager

# Get the current Revit document
doc = DocumentManager.Instance.CurrentDBDocument

# Input: List of integers representing the Element IDs
instance_ids = IN[0]

# Initialize an empty list to store the resulting ElementId objects
element_ids = []

# Loop through each integer ID and convert it to an ElementId
for id_int in instance_ids:
    element_id = ElementId(id_int)
    element_ids.append(element_id)

# Output: List of ElementId objects
OUT = element_ids
# ----------------------------------------
check_if_families_are_loaded = Python(IN[0]=new_familytype_creation_script)  # CPython3
# ---------- check_if_families_are_loaded.python (67 lines) ----------
import clr
from Autodesk.Revit.DB import *

clr.AddReference('RevitServices')
import RevitServices
from RevitServices.Persistence import DocumentManager

# Data entering the node
created_families = IN[0]  # Assuming incoming data is a list of lists containing family information

print("Input data (created_families):")
print(created_families)

def family_exists(doc, family_name):
    collector = FilteredElementCollector(doc)
    families = collector.OfClass(Family).ToElements()
    for family in families:
        if family.Name == family_name:
            return True
    return False











# Extract family names and remove .rfa extensions
fami = [sublist[0].replace('.rfa', '') for sublist in created_families]

print("Extracted family names (fami):")
print(fami)

def verify_families_in_project(doc, fami):
    for family_name in fami:
        print(f"Checking if family '{family_name}' exists in the project...")
        if not family_exists(doc, family_name):
            print(f"Family '{family_name}' is not loaded.")
            return False
        else:
            print(f"Family '{family_name}' is loaded.")
    return True

try:
    doc = DocumentManager.Instance.CurrentDBDocument
    print(f"Current document: {doc.Title}")

    # Verify if the families are loaded in the project
    families_loaded = verify_families_in_project(doc, fami)

    print(f"Families loaded status: {families_loaded}")

    if families_loaded:
        OUT = created_families
    else:
        OUT = [[], "The created family documents are not loaded yet."]

except Exception as e:
    OUT = [[], f"An error occurred: {str(e)}"]
    print(f"An error occurred: {e}")

print("Output data (OUT):")
print(OUT)
# ----------------------------------------
newtypeid_extractor = Python(IN[0]=new_familytype_creation_script, IN[1]=check_if_families_are_loaded)  # CPython3
# ---------- newtypeid_extractor.python (52 lines) ----------
import clr
from Autodesk.Revit.DB import *
from RevitServices.Persistence import DocumentManager

# Get the current Revit document
doc = DocumentManager.Instance.CurrentDBDocument

# Input data: List of family names
famdata = IN[1]
print(famdata)

# Define function to extract family names from 'famdata' and remove '.rfa'
def ExtractFamilyNames(famdata):
    return [item[0].replace('.rfa', '') for item in famdata]

# Call the function to extract family names
new_family_names = ExtractFamilyNames(famdata)

# Print extracted family names for debugging
print("Extracted Family Names:", new_family_names)

# Initialize a list to store lists of FamilySymbol IDs grouped by Family Name
family_symbol_ids_lists = [[] for _ in range(len(new_family_names))]

# Filtered element collector for FamilySymbol (FamilyType)
collector = FilteredElementCollector(doc).OfClass(FamilySymbol)

# Iterate through each FamilySymbol and group by Family Name
for family_symbol in collector:
    if family_symbol.FamilyName in new_family_names:
        index = new_family_names.index(family_symbol.FamilyName)
        family_symbol_ids_lists[index].append(family_symbol.Id)

# Print number of FamilySymbols found for debugging
total_symbols = sum(len(ids) for ids in family_symbol_ids_lists)
print(f"Number of FamilySymbols found: {total_symbols}")

# Initialize a list to store the last item of each sublist
last_items = []

# Iterate through each sublist and retrieve the last item
for symbol_ids_list in family_symbol_ids_lists:
    if symbol_ids_list:
        last_items.append(symbol_ids_list[-1])  # Append the last item of the sublist
    else:
        last_items.append(None)  # Append None if sublist is empty

# Print the extracted last items for debugging
print("Extracted Last Items:", last_items)

# Output the list of last items
OUT = last_items
# ----------------------------------------
replacement_script = Python(IN[0]=translation_script, IN[1]=newtypeid_extractor)  # CPython3
# ---------- replacement_script.python (70 lines) ----------
import clr
clr.AddReference('RevitAPI')
clr.AddReference('RevitServices')

from Autodesk.Revit.DB import *
from RevitServices.Persistence import DocumentManager
from RevitServices.Transactions import TransactionManager
from System.Collections.Generic import List


# Input data
family_instance_ids = IN[0]  # List of ElementId of existing FamilyInstance objects
new_family_type_ids = IN[1]  # List of ElementId of new FamilySymbol types

# Get the current document
doc = DocumentManager.Instance.CurrentDBDocument

# Start transaction
TransactionManager.Instance.EnsureInTransaction(doc)

changed_instances = []
errors = []

try:
    print("Starting Element Type Change Process...")

    for instance_id, new_type_id in zip(family_instance_ids, new_family_type_ids):
        try:
            # Get the FamilyInstance and FamilySymbol objects
            instance = doc.GetElement(instance_id)
            new_type = doc.GetElement(new_type_id)
            
            if not isinstance(instance, FamilyInstance):
                msg = f"Element with ID {instance_id} is not a FamilyInstance."
                print(msg)
                errors.append(msg)
                continue

            if not isinstance(new_type, FamilySymbol):
                msg = f"Element with ID {new_type_id} is not a FamilySymbol."
                print(msg)
                errors.append(msg)
                continue

            # Change the family type of the instance
            instance.Symbol = new_type
            changed_instances.append(instance)
            print(f"Changed family type for FamilyInstance ID {instance.Id.IntegerValue} to {new_type.Name}")

        except Exception as ex:
            msg = f"Error changing family type: {str(ex)}"
            print(msg)
            errors.append(msg)

    # Commit transaction
    TransactionManager.Instance.TransactionTaskDone()

except Exception as ex:
    # Rollback transaction if an error occurs
    TransactionManager.Instance.ForceCloseTransaction()
    msg = f"Internal Error: {str(ex)}"
    print(msg)
    errors.append(msg)
    raise ex

# Output
if errors:
    OUT = (changed_instances, errors)
else:
    OUT = changed_instances
# ----------------------------------------
excel_export_script = Python(IN[0]=export_file_path, IN[1]=matchmaking_script, IN[2]=database_excel, IN[3]=sheetname, IN[4]=replacement_script)  # CPython3
# ---------- excel_export_script.python (127 lines) ----------
import sys
import clr
clr.AddReference('ProtoGeometry')
from Autodesk.DesignScript.Geometry import *
import openpyxl
from openpyxl import Workbook
from openpyxl.utils import get_column_letter

# The inputs to this node will be stored as a list in the IN variables.
dataEnteringNode = IN

# Input variables
export_path = IN[0]
matching_data = IN[1]
marketplace_data = IN[2]
sheet_name = IN[3]

# Safely extract new_types_list from IN[4]
new_types_list = []
if isinstance(IN[4], list) and len(IN[4]) > 0 and isinstance(IN[4][0], list):
    new_types_list = IN[4][0]
else:
    print("IN[4] is either not a list or does not contain a valid sublist. 'new_types_list' will be empty.")

# Function to convert Revit FamilyInstance to a string
def family_instance_to_name_id(family_instance):
    try:
        return family_instance.Name, family_instance.Id
    except Exception as e:
        print(f"Error in family_instance_to_name_id: {e}")
        return "ConversionError", "ConversionError"

# Convert the new types to names and IDs
new_type_names_ids = []
if new_types_list:
    try:
        new_type_names_ids = [family_instance_to_name_id(fi) for fi in new_types_list]
        print("New type names and IDs converted successfully")
    except Exception as e:
        print(f"Error converting new types: {e}")
else:
    print("No new types provided. All 'New_Type_Name' and 'ID_new_window' values will be set to 'NA'.")

# Function to export data to Excel
def export_to_excel(export_path, matching_data, new_type_names_ids, sheet_name):
    try:
        # Create a workbook and select the active worksheet
        wb = Workbook()
        ws = wb.active
        ws.title = sheet_name
        
        # Define the headers
        headers = list(matching_data[0].keys()) + ['New_Type_Name', 'ID_new_window', 'GWP_after_matchmaking']
        
        # Write headers to the first row
        for col_num, header in enumerate(headers, 1):
            col_letter = get_column_letter(col_num)
            ws[f'{col_letter}1'] = header
        
        total_gwp_before = 0
        total_gwp_after = 0
        match_count = 0
        new_type_index = 0
        
        # Write the data rows
        for row_num, data_dict in enumerate(matching_data, 2):
            for col_num, (key, value) in enumerate(data_dict.items(), 1):
                col_letter = get_column_letter(col_num)
                ws[f'{col_letter}{row_num}'] = value
            
            # Determine values for new type name, ID, and GWP_after_matchmaking
            col_letter_name = get_column_letter(len(headers) - 2)
            col_letter_id = get_column_letter(len(headers) - 1)
            col_letter_gwp_after = get_column_letter(len(headers))
            
            if new_types_list:
                if data_dict.get('Match_found', False) and new_type_index < len(new_type_names_ids):
                    ws[f'{col_letter_name}{row_num}'] = new_type_names_ids[new_type_index][0]  # New Type Name
                    ws[f'{col_letter_id}{row_num}'] = new_type_names_ids[new_type_index][1]  # New Type ID
                    new_type_index += 1
                    ws[f'{col_letter_gwp_after}{row_num}'] = 0  # Set GWP_after_matchmaking to 0 if match found
                    match_count += 1
                else:
                    ws[f'{col_letter_name}{row_num}'] = 'NA'
                    ws[f'{col_letter_id}{row_num}'] = 'NA'
                    ws[f'{col_letter_gwp_after}{row_num}'] = data_dict.get('GWP (KG CO2eq)', 'NA')
            else:
                ws[f'{col_letter_name}{row_num}'] = 'NA'
                ws[f'{col_letter_id}{row_num}'] = 'NA'
                ws[f'{col_letter_gwp_after}{row_num}'] = data_dict.get('GWP (KG CO2eq)', 'NA')
            
            # Accumulate GWP values
            gwp_value = data_dict.get('GWP (KG CO2eq)', 0)
            total_gwp_before += gwp_value
            total_gwp_after += 0 if data_dict.get('Match_found', False) else gwp_value
        
        total_kg_co2_saved = total_gwp_before - total_gwp_after

        # Write summary data
        summary_row = row_num + 1
        ws[f'A{summary_row}'] = "Total GWP before matchmaking"
        ws[f'B{summary_row}'] = total_gwp_before
        ws[f'A{summary_row + 1}'] = "Total GWP after matchmaking"
        ws[f'B{summary_row + 1}'] = total_gwp_after
        ws[f'A{summary_row + 2}'] = "Number of matches made"
        ws[f'B{summary_row + 2}'] = match_count
        ws[f'A{summary_row + 3}'] = "Total KG CO2 saved"
        ws[f'B{summary_row + 3}'] = total_kg_co2_saved

        # Save the workbook to the specified path
        wb.save(export_path)
        print(f"Data exported successfully to {export_path}")
    except Exception as e:
        print(f"Error in export_to_excel: {e}")

# Construct the full export path including the file name
file_name = 'matchmaking_data.xlsx'
full_export_path = f"{export_path}/{file_name}"

# Export the matchmaking data to Excel
try:
    export_to_excel(full_export_path, matching_data, new_type_names_ids, sheet_name)
except Exception as e:
    print(f"Error during export: {e}")

# Assign your output to the OUT variable.
OUT = f"Data exported successfully to {full_export_path}"
# ----------------------------------------
watch_2 = Watch(excel_export_script)
save_new_project = Python(IN[0]=export_file_path, IN[1]=replacement_script, IN[2]=excel_export_script)  # CPython3
# ---------- save_new_project.python (46 lines) ----------
import clr
clr.AddReference('RevitAPI')
clr.AddReference('RevitServices')
from Autodesk.Revit.DB import *
from RevitServices.Persistence import DocumentManager
import os




# Inputs
directory_path = IN[0]  # Directory path input
trigger = IN[1]         # Trigger input
status_message = IN[2]  # Status message input (assumed to be a string)

# Check if the trigger input is NULL
if trigger is None:
    OUT = "Trigger is NULL. No action taken."
else:
    # Check if the status message contains the word "successfully"
    if "successfully" in status_message:
        # Access the current Revit document
        doc = DocumentManager.Instance.CurrentDBDocument

        # Function to generate a new file name with "_Alternative" appended
        def generate_new_filename(directory_path, current_name):
            base_name = os.path.splitext(current_name)[0]  # Remove the extension
            new_filename = "{}_Alternative.rvt".format(base_name)
            return os.path.join(directory_path, new_filename)

        # Get the current document's title (which is the file name without the extension)
        current_doc_title = doc.Title

        # Generate the new file path
        new_file_path = generate_new_filename(directory_path, current_doc_title)

        # Save the document with the new file name
        try:
            save_options = SaveAsOptions()
            save_options.OverwriteExistingFile = True
            doc.SaveAs(new_file_path, save_options)
            OUT = "File saved successfully at: {}".format(new_file_path)
        except Exception as e:
            OUT = "Failed to save file: {}".format(str(e))
    else:
        OUT = "Failed to save file: Status message did not indicate success."
# ----------------------------------------
watch_3 = Watch(save_new_project)
